# Grasshopper definition GeoMining_components.gh (Grasshopper 1.0.8)
# plug-ins: RhinoCodePluginGH

# ----
# Authenticate Machine
your_project_id = Panel("ee-neriiacopo-geomining")
# replace with your project-id to authenticate
py3 = Python3Script(project_id=your_project_id)  # -> out
# ---------- py3: Python ----------
# Check installed plugins ######################################
# requirements: numpy, pyproj, earthengine-api

import subprocess
import sys
import os

import ee
import locale

# Set the locale manually
locale.setlocale(locale.LC_ALL, 'en_US.UTF-8')

# Open Terminal for Authentication process within Rhino
def authenticate_machine():
    # Construct the path to python.exe within the current environment
    py_exe = os.path.join(sys.prefix, "python.exe")
    
    install_ee = f"{py_exe} -m pip install earthengine-api" # Check if ee is installed in root
    command = "import ee; ee.Authenticate(auth_mode='notebook')" # Open UI for authentication

    subprocess.run(["start", "cmd", "/c", install_ee], shell=True)
    subprocess.run(["start", "cmd", "/c", py_exe, "-c", command], shell=True)

# Initialize project
try:
    ee.Initialize(project=project_id)
    out = "Successfully authenticated"
except Exception as e:    
    try:
        authenticate_machine()
        ee.Initialize(project=project_id)
        out = "Successfully authenticated"
    except Exception as e:
        out = "Failed to Authenticate"
# ---------- end py3 ----------
panel = Panel(py3)

panel_2 = Panel("MODIS/061/MOD11A1")  # disabled
crv = Curve(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)  # disabled
crv_2 = Curve(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)  # disabled
crv_3 = Curve(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)  # disabled
crv_4 = Curve(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)  # disabled
panel_3 = Panel("""2017-06-01
2017-08-31""")  # disabled
panel_4 = Panel("LANDSAT/LE7_TOA_5YEAR/1999_2003")  # disabled
disc = Discontinuity(Curve=crv, Level=1)  # -> flatten(Points), Parameters; disabled
panel_5 = Panel("NASA/NASADEM_HGT/001")  # disabled
# remove dates to run mosaic()
panel_6 = Panel("IDAHO_EPSCOR/TERRACLIMATE")  # disabled
disc_2 = Discontinuity(Curve=crv_3, Level=1)  # -> flatten(Points), Parameters; disabled
disc_3 = Discontinuity(Curve=crv_4, Level=1)  # -> Points, Parameters; disabled
# eeFiterDates
filterdates = Python3Script(layer=panel_2, dates=panel_3)  # -> layers, days; inputs layer: String, dates: list; disabled
# ---------- filterdates: Python ----------
# Check installed plugins ######################################
# requirements: numpy, pyproj, earthengine-api

import numpy as np
import ee
import os
import rhinoscriptsyntax as rs
from pyproj import CRS
from pyproj.aoi import AreaOfInterest
from pyproj.database import query_utm_crs_info
from pyproj import Transformer

import locale

# Set the locale manually
locale.setlocale(locale.LC_ALL, 'en_US.UTF-8')


def castToFloat(o):
    list = []
    for i in o:
        list.append(float(i))

    return list

def pts_bbox(pts):
    pts_py = []

    for p in pts:
        pts_py.append([p.X, p.Y])

    aoi = ee.Geometry.Polygon(
        [[[pts_py[0][0], pts_py[0][1]],
        [pts_py[1][0], pts_py[1][1]],
        [pts_py[2][0], pts_py[2][1]],
        [pts_py[3][0], pts_py[3][1]]]], None, False)

    return aoi;

def pts_polygon(pts):

    coords = []
    for p in pts:

        coord = [p.X,p.Y]
        coords.append(coord)

    geom_polygon = ee.Geometry.Polygon([ee.Geometry.LinearRing(coords)])

    return geom_polygon

def pts_multipts(pts):

    coords = []
    for p in pts:

        coord = [p.X,p.Y]
        coords.append(coord)

    geom_pts = ee.Geometry.MultiPoint(coords)

    return geom_pts

def img_scaleTrim(image, band, mode, proj, scale, pts):

    # Create reducer for sampling mode
    reducer = "ee.Reducer."+ mode +"()"

    # Resample the image to assign custom scale
    imageResampled = image \
        .reduceResolution(reducer= eval(reducer), maxPixels = 5000) \
        .reproject(crs='EPSG:4326', scale=scale)

    # Extract the bounding region from the locations
    aoi = pts_bbox(pts)

    # Sample the image within the region
    rec_sample = imageResampled.sampleRectangle(region=aoi, defaultValue=0)

    # Prepare the outputs
    np_values = np.array(rec_sample.get(band).getInfo())
    values = np_values.flatten().tolist()

    # Change from pixel to node (vertices)
    H = np_values.shape[0] -1
    W = np_values.shape[1] -1

    return values,W,H;


def ee_filterDate(layer,dates):

    # Filter image collection
    images = ee.ImageCollection(layer) \
             .filter(ee.Filter.date(dates[0],dates[1]))

    # Get metadata
    meta = images.getInfo()
    length = len(meta["features"])
    layers = []
    days = []

    for i in range(length):
        layer = meta["features"][i]["id"]
        day = meta["features"][i]["properties"]["system:index"]
        layers.append(layer)
        days.append(day)

    return (layers, days);

# Run command if inputs are provided
if (layer != None and dates!= None) :
    layers, days = ee_filterDate(layer,dates)
# ---------- end filterdates ----------
number_slider = Slider(100, range=0..1000)  # disabled
number_slider_2 = Slider(100, range=0..1000)  # disabled
number_slider_3 = Slider(3000, range=0..10000)  # disabled
panel_7 = Panel("B5")  # disabled
panel_8 = Panel("B4")  # disabled
panel_9 = Panel("elevation")  # disabled
panel_10 = Panel("pdsi")  # disabled
# eeImageCollection
panel_11 = Panel("""2017-06-01
2017-09-01""")  # disabled
panel_12 = Panel("mean")  # disabled

number_slider_4 = Slider(0, range=0..10)  # disabled
number_slider_5 = Slider(7, range=0..10)  # disabled
fragment = TextFragment(Text=filterdates.days, Start=number_slider_4, Count=number_slider_5)  # disabled
cset = CreateSet(List=fragment)  # -> Set, Map; disabled
mindex = MemberIndex(Set=fragment, Member=cset.Set)  # -> Index, Count; disabled

# ----
# eeND
eend = Python3Script(layer=panel_4, band1=panel_8, band2=panel_7, scale=number_slider, pts=disc.Points)  # -> values, W, H; inputs layer: String, band1: String, mode: String, scale: Int32, pts: list of Point3d; disabled
#   port mode: mean, mode, max, min, sum ...
# ---------- eend: Python ----------
# Check installed plugins ######################################
# requirements: numpy, pyproj, earthengine-api

import numpy as np
import ee
import os
import rhinoscriptsyntax as rs
from pyproj import CRS
from pyproj.aoi import AreaOfInterest
from pyproj.database import query_utm_crs_info
from pyproj import Transformer


def castToFloat(o):
    list = []
    for i in o:
        list.append(float(i))

    return list

def pts_bbox(pts):
    pts_py = []

    for p in pts:
        pts_py.append([p.X, p.Y])

    aoi = ee.Geometry.Polygon(
        [[[pts_py[0][0], pts_py[0][1]],
        [pts_py[1][0], pts_py[1][1]],
        [pts_py[2][0], pts_py[2][1]],
        [pts_py[3][0], pts_py[3][1]]]], None, False)

    return aoi;

def pts_polygon(pts):

    coords = []
    for p in pts:

        coord = [p.X,p.Y]
        coords.append(coord)

    geom_polygon = ee.Geometry.Polygon([ee.Geometry.LinearRing(coords)])

    return geom_polygon

def pts_multipts(pts):

    coords = []
    for p in pts:

        coord = [p.X,p.Y]
        coords.append(coord)

    geom_pts = ee.Geometry.MultiPoint(coords)

    return geom_pts

def img_scaleTrim(image, band, mode, proj, scale, pts):

    # Create reducer for sampling mode
    reducer = "ee.Reducer."+ mode +"()"

    # Resample the image to assign custom scale
    imageResampled = image \
        .reduceResolution(reducer= eval(reducer), maxPixels = 5000) \
        .reproject(crs='EPSG:4326', scale=scale)

    # Extract the bounding region from the locations
    aoi = pts_bbox(pts)

    # Sample the image within the region
    rec_sample = imageResampled.sampleRectangle(region=aoi, defaultValue=0)

    # Prepare the outputs
    np_values = np.array(rec_sample.get(band).getInfo())
    values = np_values.flatten().tolist()

    # Change from pixel to node (vertices)
    H = np_values.shape[0] -1
    W = np_values.shape[1] -1

    return values,W,H;


def ee_ND(layer,band1,band2,mode,scale,pts):

    # Select the two bands to subtract
    image1 = ee.Image(layer).select(band1)
    image2 = ee.Image(layer).select(band2)

    # Compute Normalized Difference
    imageND = image1.subtract(image2) \
              .divide(image1.add(image2)) \
              .rename("ND")

    # Extract original projection
    proj = image1.projection()

    return img_scaleTrim(imageND, "ND", mode, proj, scale, pts);

# Run command if inputs are provided
if (layer != None and band1 != None and band2!= None and scale != None and pts != None) :
    if mode == None : mode = "mean"
    values, W, H = ee_ND(layer,band1,band2,mode,scale,pts)
# ---------- end eend ----------

toggle = BooleanToggle(True)  # disabled
py3_2 = Python3Script(pts=disc.Points, xyz=toggle)  # -> proj; inputs pts: list of Point3d, xyz: Boolean; disabled
# ---------- py3_2: Python ----------
# Check installed plugins ######################################
# requirements: numpy, pyproj, earthengine-api

import numpy as np
import ee
import os
import rhinoscriptsyntax as rs
import Rhino.Geometry as rg

from pyproj import CRS
from pyproj.aoi import AreaOfInterest
from pyproj.database import query_utm_crs_info
from pyproj import Transformer




def reproject_UTM(pts, xyz):
    # Compute the centroid location
    xs = []
    ys = []

    for p in pts:
        xs.append(p.X)
        ys.append(p.Y)

    p_mean = [np.asarray(xs).mean(),np.asarray(ys).mean()]

    # Extract UTM of the centroid location
    utm_crs_list = query_utm_crs_info(
        datum_name="WGS 84",
        area_of_interest=AreaOfInterest(
            south_lat_degree=p_mean[1],
            west_lon_degree=p_mean[0],
            north_lat_degree=p_mean[1],
            east_lon_degree=p_mean[0]
        ),
    )

    # Project from 4326 to local UTM
    WSG84_crs = CRS.from_epsg(4326)
    utm_crs = CRS.from_epsg(utm_crs_list[0].code)
    transformer = Transformer.from_crs(WSG84_crs, utm_crs, always_xy=True)

    pts_UTM = []

    p_leftbottom = transformer.transform(pts[0].X,pts[0].Y)

    for p in pts:

        # provide first X then Y -- Lon then Lat
        p_UTM = transformer.transform(p.X,p.Y)

        # Move to origin using left bottom corner
        if xyz == True:
            p_UTM = [p_UTM[0] - p_leftbottom[0], p_UTM[1] - p_leftbottom[1]]

        pts_UTM.append(rs.AddPoint(p_UTM[0], p_UTM[1], 0))

    print(pts_UTM)
    return pts_UTM

proj = reproject_UTM(pts, xyz)
# ---------- end py3_2 ----------
pline = PolyLine(Vertices=reverse(py3_2), Closed=invert(False))  # disabled
mplane = MeshPlane(Boundary=pline, WidthCount=eend.W, HeightCount=eend.H)  # -> Mesh, Area; disabled

# ----
# eeImage
eeimage = Python3Script(layer=panel_5, bands=panel_9, mode=panel_12, scale=number_slider_2, pts=disc_3.Points)  # -> values, W, H; inputs layer: String, bands: String, mode: String, scale: Int32, pts: list of Point3d; disabled
#   port mode: mean, mode, max, min, sum ...
# ---------- eeimage: Python ----------
# Check installed plugins ######################################
# requirements: numpy, pyproj, earthengine-api

import numpy as np
import ee
import os
import rhinoscriptsyntax as rs
from pyproj import CRS
from pyproj.aoi import AreaOfInterest
from pyproj.database import query_utm_crs_info
from pyproj import Transformer


def castToFloat(o):
    list = []
    for i in o:
        list.append(float(i))

    return list

def pts_bbox(pts):
    pts_py = []

    for p in pts:
        pts_py.append([p.X, p.Y])

    aoi = ee.Geometry.Polygon(
        [[[pts_py[0][0], pts_py[0][1]],
        [pts_py[1][0], pts_py[1][1]],
        [pts_py[2][0], pts_py[2][1]],
        [pts_py[3][0], pts_py[3][1]]]], None, False)

    return aoi;

def pts_polygon(pts):

    coords = []
    for p in pts:

        coord = [p.X,p.Y]
        coords.append(coord)

    geom_polygon = ee.Geometry.Polygon([ee.Geometry.LinearRing(coords)])

    return geom_polygon

def pts_multipts(pts):

    coords = []
    for p in pts:

        coord = [p.X,p.Y]
        coords.append(coord)

    geom_pts = ee.Geometry.MultiPoint(coords)

    return geom_pts

def img_scaleTrim(image, band, mode, proj, scale, pts):

    # Create reducer for sampling mode
    reducer = "ee.Reducer."+ mode +"()"

    # Resample the image to assign custom scale
    imageResampled = image \
        .reduceResolution(reducer= eval(reducer), maxPixels = 5000) \
        .reproject(crs='EPSG:4326', scale=scale)

    # Extract the bounding region from the locations
    aoi = pts_bbox(pts)

    # Sample the image within the region
    rec_sample = imageResampled.sampleRectangle(region=aoi, defaultValue=0)

    # Prepare the outputs
    np_values = np.array(rec_sample.get(band).getInfo())
    values = np_values.flatten().tolist()

    # Change from pixel to node (vertices)
    H = np_values.shape[0] -1
    W = np_values.shape[1] -1

    return values,W,H;


def ee_image(layer,bands,mode,scale,pts):

    # Select image layer
    image = ee.Image(layer)\
        .select(bands)

    # Extract original projection
    proj = image.projection()

    return img_scaleTrim(image, bands, mode, proj, scale, pts);

# Run command if inputs are provided
if (layer != None and bands != None and scale != None and pts != None) :
    if mode == None : mode = "mean"
    values, W, H = ee_image(layer,bands,mode,scale,pts)
# ---------- end eeimage ----------

toggle_2 = BooleanToggle(True)  # disabled
py3_3 = Python3Script(pts=disc_3.Points, xyz=toggle_2)  # -> proj; inputs pts: list of Point3d, xyz: Boolean; disabled; same code as py3_2
pline_2 = PolyLine(Vertices=reverse(py3_3), Closed=invert(False))  # disabled
mplane_2 = MeshPlane(Boundary=pline_2, WidthCount=eeimage.W, HeightCount=eeimage.H)  # -> Mesh, Area; disabled

imagecollection = Python3Script(layer=panel_6, bands=panel_10, dates=panel_11, scale=number_slider_3, pts=disc_2.Points)  # -> values, W, H; inputs layer: String, bands: String, dates: list, mode: String, scale: Int32, pts: list of Point3d; disabled
# ---------- imagecollection: Python ----------
# Check installed plugins ######################################
# requirements: numpy, pyproj, earthengine-api

import numpy as np
import ee
import os
import rhinoscriptsyntax as rs
from pyproj import CRS
from pyproj.aoi import AreaOfInterest
from pyproj.database import query_utm_crs_info
from pyproj import Transformer

import locale

# Set the locale manually
locale.setlocale(locale.LC_ALL, 'en_US.UTF-8')


def castToFloat(o):
    list = []
    for i in o:
        list.append(float(i))

    return list

def pts_bbox(pts):
    pts_py = []

    for p in pts:
        pts_py.append([p.X, p.Y])

    aoi = ee.Geometry.Polygon(
        [[[pts_py[0][0], pts_py[0][1]],
        [pts_py[1][0], pts_py[1][1]],
        [pts_py[2][0], pts_py[2][1]],
        [pts_py[3][0], pts_py[3][1]]]], None, False)

    return aoi;

def pts_polygon(pts):

    coords = []
    for p in pts:

        coord = [p.X,p.Y]
        coords.append(coord)

    geom_polygon = ee.Geometry.Polygon([ee.Geometry.LinearRing(coords)])

    return geom_polygon

def pts_multipts(pts):

    coords = []
    for p in pts:

        coord = [p.X,p.Y]
        coords.append(coord)

    geom_pts = ee.Geometry.MultiPoint(coords)

    return geom_pts

def img_scaleTrim(image, band, mode, proj, scale, pts):

    # Create reducer for sampling mode
    reducer = "ee.Reducer."+ mode +"()"

    # Resample the image to assign custom scale
    imageResampled = image \
        .reduceResolution(reducer= eval(reducer), maxPixels = 5000) \
        .reproject(crs='EPSG:4326', scale=scale)

    # Extract the bounding region from the locations
    aoi = pts_bbox(pts)

    # Sample the image within the region
    rec_sample = imageResampled.sampleRectangle(region=aoi, defaultValue=0)

    # Prepare the outputs
    np_values = np.array(rec_sample.get(band).getInfo())
    values = np_values.flatten().tolist()

    # Change from pixel to node (vertices)
    H = np_values.shape[0] -1
    W = np_values.shape[1] -1

    return values,W,H;


def ee_imageCollection(layer,bands,dates,mode,scale,pts):

    if dates == None:
        # Make mosaic is no dates is given
        imageColl = ee.ImageCollection(layer)\
            .select(bands)
        
        # Extract original projection
        proj = imageColl.first().projection()

        image = imageColl.mosaic()

    else:
        # Filter by date
        imageColl = ee.ImageCollection(layer)\
            .filter(ee.Filter.date(dates[0], dates[1]))\
            .select(bands)

        image = eval("imageColl." + mode + "()")

         # Extract original projection
        proj = imageColl.first().projection()


    image = image.setDefaultProjection(proj)

    return img_scaleTrim(image, bands, mode, proj, scale, pts);

# Run command if inputs are provided
if (layer != None and bands != None and scale != None and pts != None) :
    if mode == None : mode = "mean"
    values, W, H = ee_imageCollection(layer,bands,dates,mode,scale,pts)
# ---------- end imagecollection ----------

toggle_3 = BooleanToggle(True)  # disabled
py3_4 = Python3Script(pts=disc_2.Points, xyz=toggle_3)  # -> proj; inputs pts: list of Point3d, xyz: Boolean; disabled; same code as py3_2
pline_3 = PolyLine(Vertices=reverse(py3_4), Closed=invert(False))  # disabled
mplane_3 = MeshPlane(Boundary=pline_3, WidthCount=imagecollection.W, HeightCount=10)  # -> Mesh, Area; disabled

panel_13 = Panel("-1")  # disabled
panel_14 = Panel("1")  # disabled
gradient = Gradient(
    LowerLimit=panel_13,
    UpperLimit=panel_14,
    Parameter=eend.values,
    stops=[0.312: RGB(30, 0, 255), 0.5: RGB(237, 237, 0), 1: RGB(255, 0, 0)])  # disabled

bnd = Bounds(Numbers=imagecollection.values)  # disabled
dedomain = DeconstructDomain(Domain=bnd)  # -> Start, End; disabled
gradient_2 = Gradient(
    LowerLimit=dedomain.Start,
    UpperLimit=dedomain.End,
    Parameter=imagecollection.values,
    stops=[0: RGB(255, 0, 0), 0.5: RGB(237, 237, 0), 1: RGB(30, 0, 255)])  # disabled

item = ListItem(List=filterdates.layers, Index=mindex.Index, Wrap=True)  # disabled

bnd_2 = Bounds(Numbers=eeimage.values)  # disabled
dedomain_2 = DeconstructDomain(Domain=bnd_2)  # -> Start, End; disabled
gradient_3 = Gradient(
    LowerLimit=dedomain_2.Start,
    UpperLimit=dedomain_2.End,
    Parameter=eeimage.values,
    stops=[0: RGB(172, 220, 250), 1: RGB(61, 54, 186)])  # disabled

disc_4 = Discontinuity(Curve=crv_2, Level=1)  # -> flatten(Points), Parameters; disabled
item_2 = ListItem(List=item, Index=0, Wrap=True)  # -> flatten(Item); disabled

demesh = DeconstructMesh(Mesh=mplane.Mesh)  # -> Vertices, Faces, Colours, Normals; disabled
conmesh = ConstructMesh(Vertices=demesh.Vertices, Faces=demesh.Faces, Colours=gradient)  # disabled

demesh_2 = DeconstructMesh(Mesh=mplane_3.Mesh)  # -> Vertices, Faces, Colours, Normals; disabled
conmesh_2 = ConstructMesh(Vertices=demesh_2.Vertices, Faces=demesh_2.Faces, Colours=gradient_2)  # disabled

number_slider_6 = Slider(500, range=0..1000)  # disabled
panel_15 = Panel(item_2)  # disabled
panel_16 = Panel("LST_Day_1km")  # disabled
# eeImage
eeimage_2 = Python3Script(layer=item_2, bands=panel_16, scale=number_slider_6, pts=disc_4.Points)  # -> values, W, H; inputs layer: String, bands: String, mode: String, scale: Int32, pts: list of Point3d; disabled; same code as eeimage

toggle_4 = BooleanToggle(True)  # disabled
py3_5 = Python3Script(pts=disc_4.Points, xyz=toggle_4)  # -> proj; inputs pts: list of Point3d, xyz: Boolean; disabled; same code as py3_2
pline_4 = PolyLine(Vertices=reverse(py3_5), Closed=invert(False))  # disabled
mplane_4 = MeshPlane(Boundary=pline_4, WidthCount=eeimage_2.W, HeightCount=eeimage_2.H)  # -> Mesh, Area; disabled

flip = FlipMatrix(Data=eeimage_2.values)  # disabled
avr = Average(Input=flip)  # -> flatten(ArithmeticMean); disabled

item_3 = ListItem(List=mplane_4.Mesh, Index=0, Wrap=True)  # disabled

bnd_3 = Bounds(Numbers=avr)  # disabled
dedomain_3 = DeconstructDomain(Domain=bnd_3)  # -> Start, End; disabled
gradient_4 = Gradient(
    LowerLimit=dedomain_3.End,
    UpperLimit=dedomain_3.Start,
    Parameter=avr,
    stops=[0: RGB(234, 38, 0), 0.25: RGB(234, 126, 0), 0.5: RGB(254, 244, 84), 0.75: RGB(173, 203, 249), 1: RGB(75, 107, 169)])  # disabled

demesh_3 = DeconstructMesh(Mesh=item_3)  # -> Vertices, Faces, Colours, Normals; disabled
conmesh_3 = ConstructMesh(Vertices=demesh_3.Vertices, Faces=demesh_3.Faces, Colours=gradient_4)  # disabled

crv_5 = Curve(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)  # disabled
crv_6 = Curve(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)  # disabled
disc_5 = Discontinuity(Curve=crv_5, Level=1)  # -> flatten(Points), Parameters; disabled
# remove dates to run mosaic()
panel_17 = Panel("CSP/HM/GlobalHumanModification")  # disabled
# check the data to find best
# resampling mode:
# - categorical (mode)
# - linear (mean)
# - ...
panel_18 = Panel("COPERNICUS/CORINE/V20/100m/2000")  # disabled
disc_6 = Discontinuity(Curve=crv_6, Level=1)  # -> Points, Parameters; disabled
number_slider_7 = Slider(3000, range=0..10000)  # disabled
number_slider_8 = Slider(100, range=0..1000)  # disabled
panel_19 = Panel("landcover")  # disabled
panel_20 = Panel("gHM")  # disabled
panel_21 = Panel("mode")  # disabled
# eeImageCollection
imagecollection_2 = Python3Script(layer=panel_17, bands=panel_20, scale=number_slider_7, pts=disc_5.Points)  # -> values, W, H; inputs layer: String, bands: String, dates: list, mode: String, scale: Int32, pts: list of Point3d; disabled; same code as imagecollection

toggle_5 = BooleanToggle(True)  # disabled
py3_6 = Python3Script(pts=disc_5.Points, xyz=toggle_5)  # -> proj; inputs pts: list of Point3d, xyz: Boolean; disabled; same code as py3_2
pline_5 = PolyLine(Vertices=reverse(py3_6), Closed=invert(False))  # disabled
mplane_5 = MeshPlane(Boundary=pline_5, WidthCount=imagecollection_2.W, HeightCount=imagecollection_2.H)  # -> Mesh, Area; disabled

# ----
# eeImage
eeimage_3 = Python3Script(layer=panel_18, bands=panel_19, mode=panel_21, scale=number_slider_8, pts=disc_6.Points)  # -> values, W, H; inputs layer: String, bands: String, mode: String, scale: Int32, pts: list of Point3d; disabled; same code as eeimage

toggle_6 = BooleanToggle(True)  # disabled
py3_7 = Python3Script(pts=disc_6.Points, xyz=toggle_6)  # -> proj; inputs pts: list of Point3d, xyz: Boolean; disabled; same code as py3_2
pline_6 = PolyLine(Vertices=reverse(py3_7), Closed=invert(False))  # disabled
mplane_6 = MeshPlane(Boundary=pline_6, WidthCount=eeimage_3.W, HeightCount=eeimage_3.H)  # -> Mesh, Area; disabled

cset_2 = CreateSet(List=eeimage_3.values)  # -> Set, Map; disabled
lng = ListLength(List=cset_2.Set)  # disabled
wheel = ColourWheel(
    lng,
    ColourGrips_Style=31,
    ColourGrips_Grip=[2.166918358, 4.26131346, 0.07252325533, 5.308511011],
    ColourGrips_Lum=[0.5783285674, 0.8521423836],
    ColourGrips_Range=[1.093574825, 1.093574825, 1.093574825, 1.093574825],
    ColourGrips_Sat=[0.8135900738, 1])  # disabled
item_4 = ListItem(List=wheel, Index=cset_2.Map, Wrap=True)  # disabled

bnd_4 = Bounds(Numbers=imagecollection_2.values)  # disabled
dedomain_4 = DeconstructDomain(Domain=bnd_4)  # -> Start, End; disabled
gradient_5 = Gradient(
    LowerLimit=dedomain_4.Start,
    UpperLimit=dedomain_4.End,
    Parameter=imagecollection_2.values,
    stops=[0: RGB(255, 0, 0), 0.5: RGB(237, 237, 0), 1: RGB(30, 0, 255)])  # disabled

demesh_4 = DeconstructMesh(Mesh=mplane_5.Mesh)  # -> Vertices, Faces, Colours, Normals; disabled
conmesh_4 = ConstructMesh(Vertices=demesh_4.Vertices, Faces=demesh_4.Faces, Colours=gradient_5)  # disabled

demesh_5 = DeconstructMesh(Mesh=mplane_6.Mesh)  # -> Vertices, Faces, Colours, Normals; disabled
conmesh_5 = ConstructMesh(Vertices=demesh_5.Vertices, Faces=demesh_5.Faces, Colours=item_4)  # disabled

demesh_6 = DeconstructMesh(Mesh=mplane_2.Mesh)  # -> Vertices, Faces, Colours, Normals; disabled

# ----
# displace with values
Z = UnitZ(Factor=eeimage.values)  # disabled
move = Move(Geometry=demesh_6.Vertices, Motion=Z)  # -> Geometry, Transform; disabled

conmesh_6 = ConstructMesh(Vertices=move.Geometry, Faces=demesh_6.Faces, Colours=gradient_3)  # disabled
